# Grasshopper definition test.gh (Grasshopper 1.0.7)

# ---- group: RH_IN:points
pt = Point()

# ----
txt = Text()
pline = PolyLine(Vertices=pt, Closed=False)
pline_2 = PolyLine(Vertices=pt, Closed=False)
sph = Sphere(Base=pt, Radius=1)

# ---- group: RH_OUT:ConsoleLog
data = Data(pt)

# ----
geo = Geometry(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)

# ---- group: RH_OUT:Crv
crv = Curve(pline_2)

# ----
geo_2 = Geometry(pline_2)
context_bake = ContextBake(Geometry=geo)
