# Grasshopper definition test2.gh (Grasshopper 1.0.7)

a = GetNumber("10", AtLeast=1, AtMost=1, Maximum=1.797693135e+308, Minimum=-1.797693135e+308, TreeAccess=False)
b = GetNumber("10", AtLeast=1, AtMost=1, Maximum=1.797693135e+308, Minimum=-1.797693135e+308, TreeAccess=False)
addition = Addition(A=a, B=b)
context_bake = ContextBake(Geometry=addition)
